# Grasshopper definition GA_generico.gh (Grasshopper 0.9.76)
# plug-ins: Python Interpreter

panel = Panel("optimum")

# ---- group: Launcher
toggle = BooleanToggle(True)

# ----
python = PythonScript(Toggle=toggle)  # -> out, a
# ---------- python: Python ----------
"""
Created on Mon May 14 15:18 PM 2020
@author: Renato Godoi da Cruz
email: renatogcruz@hotmail.com
github: github.com/renatogcruz
"""

from random import random

class Parametro():
    def __init__(self, nome, minimo, maximo): #o valor entra nesse algoritmo
        self.nome = nome
        self.minimo = minimo
        self.maximo = maximo


class Individuo():
    def __init__(self, valores, geracao=0):
        self.valores = valores
        self.nota_avaliacao = 0
        self.geracao = geracao
        self.cromossomo = []
        
        for i in range (len(lista_parametros)):
            print(random.uniform(self.minimo, self.maximo))



if Toggle:
    lista_parametros = []
    lista_parametros.append(Parametro('Altura', 1.00, 5.00))
    lista_parametros.append(Parametro('Largura', 1.00, 10.00))
    lista_parametros.append(Parametro('Profundidade', 5.00, 20.00))
    for parametro in lista_parametros:
        print(parametro.nome)
# ---------- end python ----------
panel_2 = Panel(python.out)

# ---- group: acessando número entre max e min
python_2 = PythonScript()  # -> out, a
# ---------- python_2: Python ----------
import random 

dic = {"name": "largura", "min": 1, "max": 10}


if (type(dic["min"]) == float) and (type(dic["max"]) == float):
	print(type(dic["min"]))
	print(random.uniform(dic["min"], dic["max"])) #para flot
else:
	print(type(dic["min"]))
	print(random.randint(dic["min"], dic["max"])) #para int
# ---------- end python_2 ----------
